# Grasshopper definition 2. Production (Grasshopper file).gh (Grasshopper 1.0.7)
# plug-ins: Karamba3D, Pufferfish, Weaverbird, MeshEdit Components, Human, Kangaroo2 Components, goat

data = Data(Slider(10, range=0..50))

number_slider = Slider(2, range=2..4)
data_2 = Data(number_slider)
ln = Line(StartPoint="{0,0,0}", EndPoint="{1,0,0}")
crv = Curve(reparameterize(ln))
division = Division(A="1", B=data_2)
divlength = DivideLength(Curve=crv, Length=division)  # -> Points, Tangents, Parameters
shatter = Shatter(Curve=crv, Parameters=divlength.Parameters)
curvepoint = PointOnCurve(shatter, parameter=0.5)

# ---- group: Text Tag 3D
number = Number(number_slider)

text_tag_3d = TextTag3D(Location="{0,0.01,0}", Text=number, Size=Slider(0.007, range=0..0.01), Justification=7)
panel = Panel(number)

# ----
# Spacing along U/X-axis
number_slider_2 = Slider(9, range=8..15)
data_3 = Data(number_slider_2)
ln_2 = Line(StartPoint="{0,0,0}", EndPoint="{1,0,0}")
crv_2 = Curve(reparameterize(ln_2))
division_2 = Division(A="1", B=data_3)
divlength_2 = DivideLength(Curve=crv_2, Length=division_2)  # -> Points, Tangents, Parameters
shatter_2 = Shatter(Curve=crv_2, Parameters=divlength_2.Parameters)
curvepoint_2 = PointOnCurve(shatter_2, parameter=0.5)

# ---- group: Text Tag 3D
number_2 = Number(number_slider_2)

# GENERATING DESIGNS
panel_2 = Panel("{0,0.03,0}")
text_tag_3d_2 = TextTag3D(Location=panel_2, Text=number_2, Size=Slider(0.007, range=0..0.01), Justification=7)
panel_3 = Panel(number_2)

# ----
number_slider_3 = Slider(0.49, range=0..1)
number_slider_4 = Slider(0.09, range=0..1)
number_slider_5 = Slider(0.74, range=0..1)
merge = Merge(Data1=number_slider_4, Data2=number_slider_5, Data3=number_slider_3, Data4=number_slider_5, Data5=number_slider_4)
multiplication = Multiplication(A=merge, B=data)
Y = UnitY(Factor=multiplication)
vec = Vector(Y)

number_slider_6 = Slider(0.306, range=0..1)
number_slider_7 = Slider(0.409, range=0..1)
number_slider_8 = Slider(0.304, range=0..1)
number_slider_9 = Slider(0.968, range=0..1)
number_slider_10 = Slider(0.468, range=0..1)
merge_2 = Merge(Data1=number_slider_6, Data2=number_slider_7, Data3=number_slider_8, Data4=number_slider_9, Data5=number_slider_10)
multiplication_2 = Multiplication(A=merge_2, B=data)
Y_2 = UnitY(Factor=multiplication_2)
vec_2 = Vector(Y_2)

number_slider_11 = Slider(6, range=4..8)
data_4 = Data(number_slider_11)
ln_3 = Line(StartPoint="{0,0,0}", EndPoint="{1,0,0}")
crv_3 = Curve(reparameterize(ln_3))
division_3 = Division(A="1", B=data_4)
divlength_3 = DivideLength(Curve=crv_3, Length=division_3)  # -> Points, Tangents, Parameters
shatter_3 = Shatter(Curve=crv_3, Parameters=divlength_3.Parameters)
curvepoint_3 = PointOnCurve(shatter_3, parameter=0.5)

# ---- group: Text Tag 3D
number_3 = Number(number_slider_11)

text_tag_3d_3 = TextTag3D(Location="{0,0.02,0}", Text=number_3, Size=Slider(0.007, range=0..0.01), Justification=7)
panel_4 = Panel(number_3)

# ----
number_slider_12 = Slider(0.99, range=0..1)
number_slider_13 = Slider(0.09, range=0..1)
number_slider_14 = Slider(0.58, range=0..1)
merge_3 = Merge(Data1=number_slider_12, Data2=number_slider_13, Data3=number_slider_14, Data4=number_slider_13, Data5=number_slider_12)
multiplication_3 = Multiplication(A=merge_3, B=data)
Y_3 = UnitY(Factor=multiplication_3)
vec_3 = Vector(Y_3)

# ---- group: Drop-down Menu
unit_cell_types = ValueList({"Grid": 0, "X": 1, "Star": 2, "Cross": 3, "Tesseract": 4, "Vintiles": 5, "Octet": 6, "Diamond": 7, "Honeycomb 1": 8, "Honeycomb 2": 9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}, selected="BCC with Z strut": 17)
tetrahedron_based = Curve([<curve referenced from the Rhino model> x19])
rhombic_dodecahedron = Curve([<curve referenced from the Rhino model> x32])
tesseract = Curve([<curve referenced from the Rhino model> x32])
diamond = Curve([<curve referenced from the Rhino model> x16])
kelvin = Curve([<curve referenced from the Rhino model> x36])
helix_spring_1 = Curve(<curve referenced from the Rhino model>)
polyhedral_5 = Curve([<curve referenced from the Rhino model> x14])
truncated_cube = Curve([<curve referenced from the Rhino model> x41])
face_centered_cubic_fcc = Curve([<curve referenced from the Rhino model> x8])
g7 = Curve([<curve referenced from the Rhino model> x16])
fcc_bccz_fbccz = Curve([<curve referenced from the Rhino model> x16])
fbccz_x_y_struts = Curve([<curve referenced from the Rhino model> x26])
auxetic = Curve([<curve referenced from the Rhino model> x28])
truncated_cuboctahedron = Curve([<curve referenced from the Rhino model> x72])
gibson_ashby = Curve([<curve referenced from the Rhino model> x42])
cross = Curve([<curve referenced from the Rhino model> x25])
vintiles = Curve([<curve referenced from the Rhino model> x36])
octet = Curve([<curve referenced from the Rhino model> x37])
honeycomb_1 = Curve([<curve referenced from the Rhino model> x48])
polyhedral_9 = Curve([<curve referenced from the Rhino model> x67])
gibson_ashby_variation = Curve([<curve referenced from the Rhino model> x16])
iso_truss = Curve([<curve referenced from the Rhino model> x20])
bcc_with_z_strut = Curve([<curve referenced from the Rhino model> x12])
fcc_with_z_strut = Curve([<curve referenced from the Rhino model> x12])
cuboctahedron_z = Curve([<curve referenced from the Rhino model> x25])
octahedron = Curve([<curve referenced from the Rhino model> x12])
model_5 = Curve([<curve referenced from the Rhino model> x34])
model_5_variation = Curve([<curve referenced from the Rhino model> x40])
honeycomb_2 = Curve([<curve referenced from the Rhino model> x48])
X = Curve([<curve referenced from the Rhino model> x8])
star = Curve([<curve referenced from the Rhino model> x20])
grid = Curve([<curve referenced from the Rhino model> x12])
unit_cell_types_2 = Slider(23, range=0..40)
entwine = Entwine(
    Branch00=grid,
    Branch01=X,
    Branch02=star,
    Branch03=cross,
    Branch04=tesseract,
    Branch05=vintiles,
    Branch06=octet,
    Branch07=diamond,
    Branch08=honeycomb_1,
    Branch09=honeycomb_2,
    Branch010=kelvin,
    Branch011=helix_spring_1,
    Branch012=polyhedral_5,
    Branch013=polyhedral_9,
    Branch014=gibson_ashby_variation,
    Branch015=truncated_cube,
    Branch016=iso_truss,
    Branch017=bcc_with_z_strut,
    Branch018=tetrahedron_based,
    Branch019=face_centered_cubic_fcc,
    Branch020=fcc_with_z_strut,
    Branch021=g7,
    Branch022=fcc_bccz_fbccz,
    Branch023=fbccz_x_y_struts,
    Branch024=cuboctahedron_z,
    Branch025=rhombic_dodecahedron,
    Branch026=auxetic,
    Branch027=octahedron,
    Branch028=truncated_cuboctahedron,
    Branch029=gibson_ashby,
    Branch030=model_5,
    Branch031=model_5_variation,
    FlattenInputs=True)
viewer = ParamViewer(entwine)
item = ListItem(List=viewer, Index=unit_cell_types, Wrap=True)
branch = TreeBranch(Tree=entwine, Path=item, MaintainPaths=True)
geometry = Geometry(branch)

# ----
ln_4 = Line(StartPoint="{0,1,0}", EndPoint="{1,1,0}")
crv_4 = Curve(reparameterize(ln_4))

ln_5 = Line(StartPoint="{0,1,0}", EndPoint="{1,1,0}")
crv_5 = Curve(reparameterize(ln_5))

number_slider_15 = Slider(5, range=0..10)
subtraction = Subtraction(A=number_slider_15, B="1")
data_5 = Data(number_slider_15)
data_6 = Data(subtraction)
division_4 = Division(A="1", B=data_6)
series = Series(Start=0, Step=division_4, Count=data_5)
eval = EvaluateCurve(Curve=crv_5, Parameter=series)  # -> Point, Tangent, Angle
pt = Point(eval.Point)

ln_6 = Line(StartPoint="{0,1,0}", EndPoint="{1,1,0}")
crv_6 = Curve(reparameterize(ln_6))

# ---- group: Exoskeleton (Sole Lattice)
geometry_2 = Geometry(geometry)
curve = Curve(geometry_2)
multipipe = MultiPipe(
    Curves=curve,
    NodeSize=Slider(0.004, range=0..1),
    EndOffset=1,
    StrutSize=Slider(1, range=0..1),
    Segment=0,
    KinkAngle=0.6,
    CubeFit=0,
    Caps=Slider(1, range=0..2))

# ----
move = Move(Geometry=pt, Motion=vec_2)  # -> Geometry, Transform
pt_2 = Point(move.Geometry)
nurbs = NurbsCurve(Vertices=pt_2, Degree=3, Periodic=False)  # -> Curve, Length, Domain
crv_7 = Curve(nurbs.Curve)

# ----
# Graphically solve remapping curve
pt_3 = Point(curvepoint_2)
Y_4 = UnitY(Factor=1)
neg = Negative(Value=Y_4)
crv_8 = Curve(crv_7)
project = ProjectPoint(Point=pt_3, Direction=Y_4, Geometry=crv_8)  # -> Point, Index
project_2 = ProjectPoint(Point=pt_3, Direction=neg, Geometry=crv_8)  # -> Point, Index
null = NullItem(Item=project.Point)  # -> simplify(graft(NullFlags)), InvalidFlags, Description
merge_4 = Merge(Data1=graft(project.Point), Data2=graft(project_2.Point))  # -> simplify(Result)
item_2 = ListItem(List=merge_4, Index=null.NullFlags, Wrap=True)
pt_4 = Point(flatten(item_2))

# ----
# Determine relative spacing
pdecon = Deconstruct(Point=pt_4)  # -> XComponent, YComponent, ZComponent
data_7 = Data(pdecon.YComponent)
ma = MassAddition(Input=data_7)  # -> Result, PartialResults
division_5 = Division(A=data_7, B=ma.Result)
data_8 = Data(division_5)
panel_5 = Panel(data_8)

# ----
# Determine subdivision parameter along edge
panel_6 = Panel("0")
series_2 = Series(Start=panel_6, Step=1, Count=data_3)  # -> simplify(graft(Series))
dom = ConstructDomain(DomainStart=panel_6, DomainEnd=series_2)
subset = SubList(List=data_8, Domain=dom, Wrap=True)  # -> simplify(List), Index
ma_2 = MassAddition(Input=subset.List)  # -> flatten(Result), PartialResults
panel_7 = Panel(ma_2.Result)
ins = InsertItems(List=ma_2.Result, Item="0", Indices="0", Wrap=True)
data_9 = Data(ins)

# ----
# Control Parameters
# Not Part of the Design Space!
# Numerical Tolerance
# Absolute Model Space Tolerance
# Meshing Resolution
# Meshing Iterations
# Threshold for Vertex Removal from Interfaces
number_slider_16 = Slider(1e-05, range=0..1e-05)
num = Number(Slider(0.001, range=0..0.01))
int = Integer(Slider(0, range=0..100))
num_2 = Number(number_slider_16)
num_3 = Number(Slider(0.001, range=0..0.001))
num_4 = Number(Slider(0.02, range=0..0.1))

# ----
# Test Unit Module
crv_9 = Curve(geometry)

# ----
# Foot Geometries
# Foot Mesh
# Initial Sole Geometry
mesh = Mesh(<mesh referenced from the Rhino model>)
srf = Surface(<surface referenced from the Rhino model>)

M = Mesh(mesh)
# FEET APPROXIMATION
demesh = DeconstructMesh(Mesh=M)  # -> Vertices, Faces, Colours, Normals
pt_5 = Point(demesh.Vertices)
pdecon_2 = Deconstruct(Point=pt_5)  # -> XComponent, YComponent, ZComponent
bnd = Bounds(Numbers=pdecon_2.YComponent)
bnd_2 = Bounds(Numbers=pdecon_2.ZComponent)
bnd_3 = Bounds(Numbers=pdecon_2.XComponent)
dedomain = DeconstructDomain(Domain=bnd_3)  # -> Start, End
dedomain_2 = DeconstructDomain(Domain=bnd)  # -> Start, End
dedomain_3 = DeconstructDomain(Domain=bnd_2)  # -> Start, End
int_2 = Integer(Slider(16, range=0..100))
num_5 = Number(int_2)
python = GhPythonScript(a=dedomain.Start, b=dedomain.End, n=num_5)  # -> out, s
# ---------- python: Python ----------
__author__ = "tamk"
__version__ = "2024.05.05"

import rhinoscriptsyntax as rs

s = (b-a)/n
# ---------- end python ----------
python_2 = GhPythonScript(a=dedomain_2.Start, b=dedomain_2.End, s=python.s)  # -> out, n
# ---------- python_2: Python ----------
__author__ = "tamk"
__version__ = "2024.05.05"

import rhinoscriptsyntax as rs
n = (b-a)/s
# ---------- end python_2 ----------
python_3 = GhPythonScript(a=dedomain_3.Start, b=dedomain_3.End, s=python.s)  # -> out, n; same code as python_2
mesh_2 = Mesh(mesh)
round = Round(Number=python_2.n)  # -> Nearest, Floor, Ceiling
round_2 = Round(Number=python_3.n)  # -> Nearest, Floor, Ceiling
int_3 = Integer(round.Ceiling)
int_4 = Integer(round_2.Ceiling)
int_5 = Integer(num_5)
box = Box(mesh_2)
int_6 = Integer(int_4)
int_7 = Integer(int_5)
int_8 = Integer(int_3)
series_3 = Series(Start="0", Step=expr("1/x", int_6), Count=expr("1+x", int_6))  # -> simplify(Series)
series_4 = Series(Start="0", Step=expr("1/x", int_7), Count=expr("1+x", int_7))  # -> simplify(Series)
series_5 = Series(Start="0", Step=expr("1/x", int_8), Count=expr("1+x", int_8))  # -> simplify(Series)
box_2 = Box(box)
num_6 = Number(series_4)
num_7 = Number(series_5)
num_8 = Number(series_3)
box_3 = Box(box_2)
data_10 = Data(num_7)
data_11 = Data(num_8)
data_12 = Data(num_6)
crossref = CrossReference(ListA=data_12, ListB=data_10, ListC=data_11, CrossMode=1)  # -> ListA, ListB, ListC
box_4 = EvaluateBox(Box=box_3, UParameter=crossref.ListA, VParameter=crossref.ListB, WParameter=crossref.ListC)  # -> Plane, Point, Include
pt_6 = Point(box_4.Plane)
data_13 = Data(int_5)
data_14 = Data(int_3)
data_15 = Data(int_4)
python_4 = PythonScript(x=data_13, y=data_14, z=data_15, pointlist=pt_6)  # -> out, cube; inputs pointlist: list
# ---------- python_4: Python ----------
x = int (x) + 1
y = int (y) + 1
z = int (z) + 1

cube = []
points = []

count = 0
for k in range (0, z):
    points.append([])
    for j in range (0, y): 
        points[k].append([])
        for i in range (0, x):
            points[k][j].append(pointlist[count])
            count = count + 1

count = 0
for k in range (0, z-1):
    for j in range (0, y-1): 
        for i in range (0, x-1):
            cube.append([])
            cube[count].append(points[k][j][i])
            cube[count].append(points[k][j][i+1])
            cube[count].append(points[k][j+1][i+1])
            cube[count].append(points[k][j+1][i])
            cube[count].append(points[k+1][j][i])
            cube[count].append(points[k+1][j][i+1])
            cube[count].append(points[k+1][j+1][i+1])
            cube[count].append(points[k+1][j+1][i])
            count = count + 1
# ---------- end python_4 ----------
python_5 = PythonScript(x=python_4.cube)  # -> simplify(a)
# ---------- python_5: Python ----------
a=x
# ---------- end python_5 ----------
pt_7 = Point(python_5)
item_3 = ListItem(List=pt_7, Index=0, Wrap=True)  # -> Item, Item1, Item2, Item3, Item4, Item5, Item6, Item7
tbox = TwistedBox(
    CornerA=item_3.Item,
    CornerB=item_3.Item1,
    CornerC=item_3.Item2,
    CornerD=item_3.Item3,
    CornerE=item_3.Item4,
    CornerF=item_3.Item5,
    CornerG=item_3.Item6,
    CornerH=item_3.Item7)
geo = Geometry(tbox)

# ----
# Extract relevant feet geometries
number_slider_17 = Slider(0.12, range=0..1)
mesh_3 = Mesh(mesh_2)
facen = FaceNormals(Mesh=mesh_3)  # -> Centers, Normals
faceb = FaceBoundaries(Mesh=mesh_3)
num_9 = Number(number_slider_17)
num_10 = Number(Slider(0.49, range=0..1))
num_11 = Number(num_2)
num_12 = Number(Slider(0.033, range=0..1))
crv_10 = Curve(faceb)
pt_8 = Point(facen.Centers)
pdecon_3 = Deconstruct(Point=pt_8)  # -> XComponent, YComponent, ZComponent
vec_4 = Vector(facen.Normals)
devec = DeconstructVector(Vector=vec_4)  # -> XComponent, YComponent, ZComponent
vlen = VectorLength(Vector=vec_4)
num_13 = Number(pdecon_3.ZComponent)
num_14 = Number(vlen)
num_15 = Number(devec.ZComponent)
crv_11 = Curve(crv_10)
num_16 = Number(num_13)
num_17 = Number(num_9)
division_6 = Division(A=num_15, B=num_14)
larger = LargerThan(FirstNumber=num_16, SecondNumber=num_17)  # -> LargerThan, OrEqualTo
abs = Absolute(Value=division_6)
smaller = SmallerThan(FirstNumber=num_15, SecondNumber=num_11)  # -> SmallerThan, OrEqualTo
larger_2 = LargerThan(FirstNumber=abs, SecondNumber=num_10)  # -> LargerThan, OrEqualTo
smaller_2 = SmallerThan(FirstNumber=num_13, SecondNumber=num_12)  # -> SmallerThan, OrEqualTo
dispatch = Dispatch(List=crv_11, DispatchPattern=larger.LargerThan)  # -> ListA, ListB
and = GateAnd(D=smaller_2.SmallerThan, A=larger_2.LargerThan, B=smaller.SmallerThan)
num_18 = Number(num_2)
crv_12 = Curve(crv_10)
crv_13 = Curve(dispatch.ListA)
crv_14 = Curve(crv_13)
dispatch_2 = Dispatch(List=crv_12, DispatchPattern=and)  # -> ListA, ListB
cluster = Cluster_2(crv=crv_14, num=num_18)
crv_15 = Curve(dispatch_2.ListA)
crv_16 = Curve(flatten(crv_15))
pline2msh = PolylineToMesh(Polyline=crv_16, Quadrangulate=True)
pt_9 = Point(cluster)
num_19 = Number(num_2)
crv_17 = Curve(crv_15)
fcircle = CircleFit(Points=pt_9)  # -> Circle, Radius, Deviation
wbjoin = WeaverbirdsJoinMeshesAndWeld(Mesh=pline2msh, Weld=True)
cluster_2 = Cluster_2(crv=crv_17, num=num_19)
crv_18 = Curve(fcircle.Circle)
pt_10 = Point(cluster_2)
srf_2 = Surface(crv_18)
mesh_4 = Mesh(wbjoin)
pt_11 = Point(flatten(pt_9))
srf_3 = Surface(srf_2)
project_3 = ProjectPoint(Point=pt_11, Direction=Vector(0, 0, -1), Geometry=srf_3)  # -> Point, Index
null_2 = NullItem(Item=project_3.Point)  # -> NullFlags, InvalidFlags, Description
dispatch_3 = Dispatch(List=project_3.Point, DispatchPattern=null_2.NullFlags)  # -> ListA, ListB
pt_12 = Point(flatten(dispatch_3.ListB))

# ----
# Sole Surface Adjustment
srf_4 = Surface(srf)
crv_19 = Curve(srf_4)
divide = DivideCurve(Curve=crv_19, Count=Slider(50, range=0..100), Kinks=False)  # -> Points, Tangents, Parameters
int_9 = Integer(Slider(16, range=0..100))
bnd_4 = Bounds2D(Coordinates=divide.Points)
dedom2num = DeconstructDomain²(Domain=bnd_4)  # -> UMin, UMax, VMin, VMax
num_20 = Number(int_9)
python_6 = GhPythonScript(a=dedom2num.UMin, b=dedom2num.UMax, n=num_20)  # -> out, s; same code as python
python_7 = GhPythonScript(a=dedom2num.VMin, b=dedom2num.VMax, s=python_6.s)  # -> out, n; same code as python_2
round_3 = Round(Number=python_7.n)  # -> Nearest, Floor, Ceiling
int_10 = Integer(num_20)
int_11 = Integer(int_10)
int_12 = Integer(round_3.Ceiling)
int_13 = Integer(int_12)
sdivide = DivideSurface(Surface=srf_4, UCount=int_11, VCount=int_13)  # -> Points, Normals, Parameters
P = Point(sdivide.Points)
crv_20 = Curve(<curve referenced from the Rhino model>)
mesh_5 = Mesh(mesh_4)
P_2 = Point(simplify(graft(P)))
wbcatmullclark = WeaverbirdsCatmullClarkSubdivision(MeshCurves=mesh_5, Level=1, SmoothNakedEdges=1)
Z = UnitZ(Factor=1)
C = Curves(crv_20)
neg_2 = Negative(Value=Z)
mesh_6 = Mesh(wbcatmullclark)
G = Geometry(mesh_6)
move_2 = Move(Geometry=P_2, Motion=neg_2)  # -> Geometry, Transform
project_4 = ProjectPoint(Point=move_2.Geometry, Direction=Z, Geometry=G)  # -> Point, Index
nv = NakedVertices(Mesh=wbcatmullclark)  # -> ClothedIndex, NakedIndex, ClothedPts, NakedPts
scale = Scale(Geometry=C, Center=Point(0, 0, 0), Factor="1000")  # -> Geometry, Transform
P_3 = Point(project_4.Point)
null_3 = NullItem(Item=P_3)  # -> NullFlags, InvalidFlags, Description
pt_13 = Point(nv.NakedPts)
dispatch_4 = Dispatch(List=P_2, DispatchPattern=null_3.NullFlags)  # -> simplify(ListA), ListB
dispatch_5 = Dispatch(List=P_3, DispatchPattern=null_3.NullFlags)  # -> simplify(ListA), ListB
pt_14 = Point(dispatch_5.ListB)
pt_15 = Point(pt_14)
project_5 = Project(Geometry=pt_15, Plane=PlaneXY(0, 0, 0))  # -> Geometry, Transform
scale_2 = Scale(Geometry=project_5.Geometry, Center=Point(0, 0, 0), Factor="1000")  # -> Geometry, Transform
incurves = PointInCurves(Point=scale_2.Geometry, Curves=scale.Geometry)  # -> Relationship, Index, Point
larger_3 = LargerThan(FirstNumber=incurves.Relationship, SecondNumber="1")  # -> LargerThan, OrEqualTo
dispatch_6 = Dispatch(List=pt_15, DispatchPattern=larger_3.LargerThan)  # -> ListA, ListB
pt_16 = Point(dispatch_6.ListA)
pt_17 = Point(dispatch_6.ListB)
pt_18 = Point(dispatch_4.ListA)
genes = GenePool(Decimals=2, Maximum=1, Minimum=0, Value=[0.41, 0.28, 0, 0.21, 0, 0, 0.15, 0, 0, 0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])
genes_2 = GenePool(Decimals=2, Maximum=1, Minimum=0, Value=[0.34, 0.51, 0.38, 0.35, 0.54, 0.37, 0.43, 0.34, 0.35])
genes_3 = GenePool(Decimals=2, Maximum=1, Minimum=0, Value=[0.67, 0.49, 0.38, 0.55, 0.46, 0.52, 0.46, 0.12, 0.87, 0.11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])
multiplication_4 = Multiplication(A=genes, B=Slider(0.002, range=0..0.005))
clean = CleanTree(RemoveNulls=True, RemoveInvalid=True, RemoveEmpty=True, Tree=pt_17)
multiplication_5 = Multiplication(A=genes_3, B=Slider(0.005, range=0..0.005))
multiplication_6 = Multiplication(A=genes_2, B=Slider(0.002, range=0..0.005))
clean_2 = CleanTree(RemoveNulls=True, RemoveInvalid=True, RemoveEmpty=True, Tree=pt_16)
neg_3 = Negative(Value=multiplication_4)
neg_4 = Negative(Value=multiplication_6)
Z_2 = UnitZ(Factor="-0.001")  # -> simplify(graft(UnitVector))
Z_3 = UnitZ(Factor=multiplication_5)  # -> simplify(graft(UnitVector))
Z_4 = UnitZ(Factor=neg_3)  # -> simplify(graft(UnitVector))
Z_5 = UnitZ(Factor="-0.002")  # -> simplify(graft(UnitVector))
Z_6 = UnitZ(Factor=neg_4)  # -> simplify(graft(UnitVector))
clean_3 = CleanTree(RemoveNulls=True, RemoveInvalid=True, RemoveEmpty=True, Tree=pt_18)
addition = Addition(A=Z_2, B=Z_4)
addition_2 = Addition(A=Z_5, B=Z_6)
match = MatchTree(Tree=Z_3, Guide=clean_3)
move_3 = Move(Geometry=clean, Motion=addition)  # -> Geometry, Transform
move_4 = Move(Geometry=clean_2, Motion=addition_2)  # -> Geometry, Transform
move_5 = Move(Geometry=clean_3, Motion=match)  # -> Geometry, Transform
pt_19 = Point(move_3.Geometry)
pt_20 = Point(move_4.Geometry)
merge_5 = Merge(Data1=pt_20, Data2=pt_19)
pt_21 = Point(merge_5)
pt_22 = Point(move_5.Geometry)
merge_6 = Merge(Data1=pt_22, Data2=pt_21)
trim = TrimTree(Tree=merge_6, Depth=1)
P_4 = Point(pt_19)
galapagos = Galapagos(fitness=num_23, gene=genes)
goat = Goat(fitness=num_22, gene=[genes, genes_2, genes_3])
pt_23 = Point(flatten(trim))
U = UCount(int_10)
G_2 = Geometry(mesh_6)
cluster_3 = Cluster_5(P=P_4, G=G_2)
srfgrid = SurfaceFromPoints(Points=pt_23, UCount=expr("x+1", U), Interpolate=False)
srf_5 = Surface(srfgrid)
points = PointList(Points=flatten(pt_19), Size=Slider(0.004, range=0..0.01))
pt_24 = Point(cluster_3)
num_21 = Number("0.001")
pdecon_4 = Deconstruct(Point=pt_24)  # -> XComponent, YComponent, ZComponent
srf_6 = Surface(reparameterize(srfgrid))
srf_7 = Surface(srf_6)
srf_cp = SurfaceClosestPoint(Point=pt_23, Surface=srf_7)  # -> Point, UVPoint, Distance
G_3 = Geometry(srf_6)
curvature = SurfaceCurvature(Surface=srf_7, Point=srf_cp.UVPoint)  # -> Frame, Gaussian, Mean
cluster_4 = Cluster_5(P=P_4, G=G_3)
pt_25 = Point(cluster_4)
pdecon_5 = Deconstruct(Point=pt_25)  # -> XComponent, YComponent, ZComponent
x = Value(curvature.Mean)
subtraction_2 = Subtraction(A=pdecon_4.ZComponent, B=pdecon_5.ZComponent)
abs_2 = Absolute(Value=x)
avr = Average(Input=abs_2)
clean_4 = CleanTree(RemoveNulls=True, RemoveInvalid=True, RemoveEmpty=True, Tree=subtraction_2)
subtraction_3 = Subtraction(A=num_21, B=clean_4)
sqr = Square(Value=subtraction_3)
num_22 = Number(avr)
ma_3 = MassAddition(Input=flatten(sqr))  # -> Result, PartialResults
multiplication_7 = Multiplication(A="10e5", B=ma_3.Result)
num_23 = Number(multiplication_7)
addition_3 = Addition(A=num_22, B=num_23)
num_24 = Number(addition_3)
panel_8 = Panel(subtraction_3)
panel_9 = Panel(num_24)
panel_10 = Panel(avr)

# ----
# SOLE SURFACE
srf_8 = Surface(reparameterize(srf_6))
srf_9 = Surface(reparameterize(srf_8))
project_6 = Project(Geometry=srf_9, Plane=PlaneXY(0, 0, 0))  # -> Geometry, Transform
srf_10 = Surface(reparameterize(project_6.Geometry))

# ----
# Feet Shell Interface
number_slider_18 = Slider(3.5, range=0..10)
num_25 = Number(int_2)
int_14 = Integer(number_slider_18)
multiplication_8 = Multiplication(A=num_25, B=int_14)
num_26 = Number(multiplication_8)
python_8 = GhPythonScript(a=dedomain.Start, b=dedomain.End, n=num_26)  # -> out, s; same code as python
python_9 = GhPythonScript(a=dedomain_2.Start, b=dedomain_2.End, s=python_8.s)  # -> out, n; same code as python_2
dom_2 = ConstructDomain(DomainStart=dedomain.Start, DomainEnd=dedomain.End)
dom_3 = ConstructDomain(DomainStart=dedomain_2.Start, DomainEnd=dedomain_2.End)
rectangle = Rectangle(Plane=PlaneXY(0, 0, 0), XSize=dom_2, YSize=dom_3, Radius=0)  # -> Rectangle, Length
round_4 = Round(Number=num_26)  # -> Nearest, Floor, Ceiling
round_5 = Round(Number=python_9.n)  # -> Nearest, Floor, Ceiling
int_15 = Integer(round_5.Ceiling)
int_16 = Integer(round_4.Ceiling)
series_6 = Series(Start="0", Step=expr("1/x", int_15), Count=expr("1+x", int_15))  # -> simplify(Series)
series_7 = Series(Start="0", Step=expr("1/x", int_16), Count=expr("1+x", int_16))  # -> simplify(Series)
S = Surface(reparameterize(rectangle.Rectangle))
num_27 = Number(series_6)
num_28 = Number(series_7)
crossref_2 = CrossReference(ListA=num_28, ListB=num_27, CrossMode=1)  # -> ListA, ListB
pt_26 = ConstructPoint(XCoordinate=crossref_2.ListA, YCoordinate=crossref_2.ListB, ZCoordinate=0)
pt_27 = Point(pt_26)
evalsrf = EvaluateSurface(Surface=S, Point=pt_27)  # -> Point, Normal, UDirection, VDirection, Frame
pt_28 = Point(evalsrf.Point)
pt_29 = Point(pt_28)
mesh_7 = Mesh(mesh_4)
mesh_8 = Mesh(mesh_7)
Z_7 = UnitZ(Factor="0.1")
move_6 = Move(Geometry=mesh_8, Motion=Z_7)  # -> Geometry, Transform
project_7 = ProjectPoint(Point=pt_29, Direction=Z_7, Geometry=move_6.Geometry)  # -> Point, Index
neg_5 = Negative(Value=Z_7)
null_4 = NullItem(Item=project_7.Point)  # -> NullFlags, InvalidFlags, Description
dispatch_7 = Dispatch(List=project_7.Point, DispatchPattern=null_4.NullFlags)  # -> ListA, ListB
move_7 = Move(Geometry=dispatch_7.ListB, Motion=neg_5)  # -> Geometry, Transform
pt_30 = Point(move_7.Geometry)

crv_21 = Curve()  # disabled
group = Group()  # disabled
num_29 = Number(num_2)
num_30 = Number(num_2)
geo_2 = Geometry(geo)
box_5 = Box(group)  # disabled
box_6 = Box(geo)  # disabled
crv_22 = Curve()  # disabled
cluster_5 = Cluster(geo=geo_2, ldist=num_29)
morph = BoxMorph(Geometry=crv_22, Reference=box_5, Target=box_6)  # disabled
crv_23 = Curve(cluster_5)
crv_24 = Curve(flatten(morph))  # disabled
crv_25 = Curve(crv_23)
merge_7 = Merge(Data1=crv_25, Data2=crv_24)
crv_26 = Curve(flatten(merge_7))

# ----
# Feet Lattice
crv_27 = Curve(crv_26)
mesh_9 = Mesh(mesh_2)
data_16 = Data(num_3)
crv_28 = Curve(reparameterize(simplify(graft(crv_27))))
mcx = MeshCurve(Mesh=mesh_9, Curve=crv_27)  # -> simplify(Points), Faces
pt_31 = Point(simplify(mcx.Points))
num_31 = Number(num_2)
crv_cp = CurveClosestPoint(Point=pt_31, Curve=crv_28)  # -> Point, Parameter, Distance
mesh_10 = Mesh(mesh_4)
pt_32 = Point(flatten(pt_31))
pt_33 = Point(pt_32)
meshcp = MeshClosestPoint(Point=pt_33, Mesh=mesh_10)  # -> Point, Index, Parameter
python_10 = GhPythonScript(t=crv_cp.Parameter, tol=data_16)  # -> out, t; inputs t: list
# ---------- python_10: Python ----------
__author__ = "tamk"
__version__ = "2024.04.05"

import rhinoscriptsyntax as rs
from copy import copy
t_ = copy(t)

is_empty = len(t_) < 1
if is_empty or t[0] >= tol:
    t_.insert(0.0, 0)
if is_empty or t[-1] <= (1-tol):
    t_.append(1.00)
# ---------- end python_10 ----------
dist = Distance(PointA=pt_33, PointB=meshcp.Point)
smaller_3 = SmallerThan(FirstNumber=dist, SecondNumber=num_31)  # -> SmallerThan, OrEqualTo
num_32 = Number(python_10.t)
shatter_4 = Shatter(Curve=crv_28, Parameters=num_32)  # -> simplify(Segments)
dispatch_8 = Dispatch(List=pt_33, DispatchPattern=smaller_3.SmallerThan)  # -> ListA, ListB
crv_29 = Curve(shatter_4)
num_33 = Number(num_2)
pt_34 = Point(dispatch_8.ListA)
crv_30 = Curve(crv_29)
mesh_11 = Mesh(mesh_9)
rdpoints = RemoveDuplicatePointsKaramba3D(Point=pt_34, LimitDistance=num_33)  # -> OutPoint, Info, Indexes
curvepoint_4 = PointOnCurve(crv_30, parameter=0.5)
pt_35 = Point(flatten(rdpoints.OutPoint))
pt_36 = Point(curvepoint_4)
pt_37 = Point(pt_36)
minc = MeshInclusion(Mesh=mesh_11, Point=pt_37, Strict=False)
dispatch_9 = Dispatch(List=crv_30, DispatchPattern=minc)  # -> ListA, ListB
crv_31 = Curve(dispatch_9.ListA)
crv_32 = Curve(flatten(crv_31))

# ----
# Generate Load Patch
number_slider_19 = Slider(0.02, range=0..1)
pt_38 = Point(flatten(pt_12))
srf_11 = Surface(srf_2)
num_34 = Number(num_4)
int_17 = Integer(int)
merge_8 = Merge(Data1=pt_38)
Z_8 = UnitZ(Factor=number_slider_19)
pt_39 = Point(merge_8)
mesh_breps = MeshBrepsKaramba3D(
    Brep=srf_11,
    InclusionPoints=pt_39,
    MeshResolution=num_34,
    EdgeRefinementFactor=0.67,
    PointReduction=False,
    SmoothingStepSize=0,
    SmoothingIterations=int_17)  # -> Mesh, Info
move_8 = Move(Geometry=mesh_breps.Mesh, Motion=Z_8)  # -> Geometry, Transform
mesh_12 = Mesh(move_8.Geometry)
mesh_13 = Mesh(mesh_12)

unit_y = UnitY(Factor=expr("-x", Slider(0.75, range=0..10)))

# ----
# LOAD
number_slider_20 = Slider(5, range=0..1000)
mesh_14 = Mesh(mesh_13)
Z_9 = UnitZ(Factor=number_slider_20)
neg_6 = Negative(Value=Z_9)
loads = LoadsKaramba3D(Vector=neg_6, Mesh=mesh_14, LCase="0", mode="MeshLoad -Const.", menu=[buttons(off, off, on), buttons(on, on)])
load = Load(loads)

# ---- group: Turn on this to start recording; rewrites over file
boolean_toggle = BooleanToggle(True)

boolean_toggle_2 = BooleanToggle(True)

# ---- group: Generation of Exoskeleton (Unit Cells)
grid_2 = Curve([<curve referenced from the Rhino model> x12])
X_2 = Curve([<curve referenced from the Rhino model> x8])
star_2 = Curve([<curve referenced from the Rhino model> x20])
cross_2 = Curve([<curve referenced from the Rhino model> x25])
tesseract_2 = Curve([<curve referenced from the Rhino model> x32])
vintiles_2 = Curve([<curve referenced from the Rhino model> x36])
octet_2 = Curve([<curve referenced from the Rhino model> x36])
honeycomb_1_2 = Curve([<curve referenced from the Rhino model> x48])
honeycomb_2_2 = Curve([<curve referenced from the Rhino model> x48])
kelvin_2 = Curve([<curve referenced from the Rhino model> x36])
helix_spring_1_2 = Curve(<curve referenced from the Rhino model>)
polyhedral_5_2 = Curve([<curve referenced from the Rhino model> x6])
polyhedral_9_2 = Curve([<curve referenced from the Rhino model> x60])
gibson_ashby_variation_2 = Curve([<curve referenced from the Rhino model> x16])
truncated_cube_2 = Curve([<curve referenced from the Rhino model> x36])
bcc_with_z_strut_2 = Curve([<curve referenced from the Rhino model> x12])
tetrahedron_based_2 = Curve([<curve referenced from the Rhino model> x19])
fcc_with_z_strut_2 = Curve([<curve referenced from the Rhino model> x12])
g7_2 = Curve([<curve referenced from the Rhino model> x16])
fbccz_x_y_struts_2 = Curve([<curve referenced from the Rhino model> x26])
cuboctahedron_z_2 = Curve([<curve referenced from the Rhino model> x25])
rhombic_dodecahedron_2 = Curve([<curve referenced from the Rhino model> x32])
auxetic_2 = Curve([<curve referenced from the Rhino model> x28])
octahedron_2 = Curve([<curve referenced from the Rhino model> x12])
truncated_cuboctahedron_2 = Curve([<curve referenced from the Rhino model> x72])
gibson_ashby_2 = Curve([<curve referenced from the Rhino model> x42])
model_5_2 = Curve([<curve referenced from the Rhino model> x34])
model_5_variation_2 = Curve([<curve referenced from the Rhino model> x40])
diamond_2 = Curve([<curve referenced from the Rhino model> x16])
iso_truss_2 = Curve([<curve referenced from the Rhino model> x20])
face_centered_cubic_fcc_2 = Curve([<curve referenced from the Rhino model> x8])
fcc_bccz_fbccz_2 = Curve([<curve referenced from the Rhino model> x16])
unit_cell_types_3 = Slider(40, range=0..40)
entwine_2 = Entwine(
    Branch00=grid_2,
    Branch01=X_2,
    Branch02=star_2,
    Branch03=cross_2,
    Branch04=tesseract_2,
    Branch05=vintiles_2,
    Branch06=octet_2,
    Branch07=diamond_2,
    Branch08=honeycomb_1_2,
    Branch09=honeycomb_2_2,
    Branch010=kelvin_2,
    Branch011=helix_spring_1_2,
    Branch012=polyhedral_5_2,
    Branch013=polyhedral_9_2,
    Branch014=gibson_ashby_variation_2,
    Branch015=truncated_cube_2,
    Branch016=iso_truss_2,
    Branch017=bcc_with_z_strut_2,
    Branch018=tetrahedron_based_2,
    Branch019=face_centered_cubic_fcc_2,
    Branch020=fcc_with_z_strut_2,
    Branch021=g7_2,
    Branch022=fcc_bccz_fbccz_2,
    Branch023=fbccz_x_y_struts_2,
    Branch024=cuboctahedron_z_2,
    Branch025=rhombic_dodecahedron_2,
    Branch026=auxetic_2,
    Branch027=octahedron_2,
    Branch028=truncated_cuboctahedron_2,
    Branch029=gibson_ashby_2,
    Branch030=model_5_2,
    Branch031=model_5_variation_2,
    FlattenInputs=True)
viewer_2 = ParamViewer(entwine_2)
unit_cell_types_4 = ValueList({"Grid": 0, "X": 1, "Star": 2, "Cross": 3, "Tesseract": 4, "Vintiles": 5, "Octet": 6, "Diamond": 7, "Honeycomb 1": 8, "Honeycomb 2": 9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}, selected="Octet")
item_4 = ListItem(List=viewer_2, Index=unit_cell_types_4, Wrap=True)
item_5 = ListItem(List=viewer_2, Index=unit_cell_types_4, Wrap=True)
branch_2 = TreeBranch(Tree=entwine_2, Path=item_4, MaintainPaths=True)
geometry_3 = Geometry(branch_2)

# ----
number_slider_21 = Slider(5, range=0..10)
data_17 = Data(number_slider_21)

number_slider_22 = Slider(5, range=0..10)
data_18 = Data(number_slider_22)

# ----
# Spacing along W/Z-axis
subtraction_4 = Subtraction(A=number_slider_21, B="1")

data_19 = Data(subtraction_4)
division_7 = Division(A="1", B=data_19)
series_8 = Series(Start=0, Step=division_7, Count=data_17)
eval_2 = EvaluateCurve(Curve=crv_4, Parameter=series_8)  # -> Point, Tangent, Angle
pt_40 = Point(eval_2.Point)

move_9 = Move(Geometry=pt_40, Motion=vec)  # -> Geometry, Transform
pt_41 = Point(move_9.Geometry)
nurbs_2 = NurbsCurve(Vertices=pt_41, Degree=3, Periodic=False)  # -> Curve, Length, Domain
crv_33 = Curve(nurbs_2.Curve)

# ----
# Graphically solve remapping curve
Y_5 = UnitY(Factor=1)
neg_7 = Negative(Value=Y_5)
pt_42 = Point(curvepoint)
crv_34 = Curve(crv_33)
project_8 = ProjectPoint(Point=pt_42, Direction=neg_7, Geometry=crv_34)  # -> Point, Index
project_9 = ProjectPoint(Point=pt_42, Direction=Y_5, Geometry=crv_34)  # -> Point, Index
null_5 = NullItem(Item=project_9.Point)  # -> simplify(graft(NullFlags)), InvalidFlags, Description
merge_9 = Merge(Data1=graft(project_9.Point), Data2=graft(project_8.Point))  # -> simplify(Result)
item_6 = ListItem(List=merge_9, Index=null_5.NullFlags, Wrap=True)
pt_43 = Point(flatten(item_6))

# ----
# Determine relative spacing
pdecon_6 = Deconstruct(Point=pt_43)  # -> XComponent, YComponent, ZComponent
data_20 = Data(pdecon_6.YComponent)
ma_4 = MassAddition(Input=data_20)  # -> Result, PartialResults
division_8 = Division(A=data_20, B=ma_4.Result)
data_21 = Data(division_8)

# ----
# Determine subdivision parameter along edge
panel_11 = Panel("0")
series_9 = Series(Start=panel_11, Step=1, Count=data_2)  # -> simplify(graft(Series))
dom_4 = ConstructDomain(DomainStart=panel_11, DomainEnd=series_9)
subset_2 = SubList(List=data_21, Domain=dom_4, Wrap=True)  # -> simplify(List), Index
ma_5 = MassAddition(Input=subset_2.List)  # -> flatten(Result), PartialResults
panel_12 = Panel(ma_5.Result)
ins_2 = InsertItems(List=ma_5.Result, Item="0", Indices="0", Wrap=True)
data_22 = Data(ins_2)

panel_13 = Panel(data_21)

# ----
# Spacing along V/Y-axis
subtraction_5 = Subtraction(A=number_slider_22, B="1")

data_23 = Data(subtraction_5)
division_9 = Division(A="1", B=data_23)
series_10 = Series(Start=0, Step=division_9, Count=data_18)
eval_3 = EvaluateCurve(Curve=crv_6, Parameter=series_10)  # -> Point, Tangent, Angle
pt_44 = Point(eval_3.Point)

move_10 = Move(Geometry=pt_44, Motion=vec_3)  # -> Geometry, Transform
pt_45 = Point(move_10.Geometry)
nurbs_3 = NurbsCurve(Vertices=pt_45, Degree=3, Periodic=False)  # -> Curve, Length, Domain
crv_35 = Curve(nurbs_3.Curve)

# ----
# Graphically solve remapping curve
pt_46 = Point(curvepoint_3)
crv_36 = Curve(crv_35)
Y_6 = UnitY(Factor=1)
neg_8 = Negative(Value=Y_6)
project_10 = ProjectPoint(Point=pt_46, Direction=neg_8, Geometry=crv_36)  # -> Point, Index
project_11 = ProjectPoint(Point=pt_46, Direction=Y_6, Geometry=crv_36)  # -> Point, Index
null_6 = NullItem(Item=project_11.Point)  # -> simplify(graft(NullFlags)), InvalidFlags, Description
merge_10 = Merge(Data1=graft(project_11.Point), Data2=graft(project_10.Point))  # -> simplify(Result)
item_7 = ListItem(List=merge_10, Index=null_6.NullFlags, Wrap=True)
pt_47 = Point(flatten(item_7))

# ----
# Determine relative spacing
pdecon_7 = Deconstruct(Point=pt_47)  # -> XComponent, YComponent, ZComponent
data_24 = Data(pdecon_7.YComponent)
ma_6 = MassAddition(Input=data_24)  # -> Result, PartialResults
division_10 = Division(A=data_24, B=ma_6.Result)
data_25 = Data(division_10)

# ----
# Determine subdivision parameter along edge
panel_14 = Panel("0")
series_11 = Series(Start=panel_14, Step=1, Count=data_4)  # -> simplify(graft(Series))
dom_5 = ConstructDomain(DomainStart=panel_14, DomainEnd=series_11)
subset_3 = SubList(List=data_25, Domain=dom_5, Wrap=True)  # -> simplify(List), Index
ma_7 = MassAddition(Input=subset_3.List)  # -> flatten(Result), PartialResults
panel_15 = Panel(ma_7.Result)
ins_3 = InsertItems(List=ma_7.Result, Item="0", Indices="0", Wrap=True)
data_26 = Data(ins_3)

panel_16 = Panel(data_25)

# ----
# SOLE LATTICE
crossref_3 = CrossReference(ListA=data_9, ListB=data_26, ListC=data_22, CrossMode=1)  # -> ListA, ListB, ListC
num_35 = Number(simplify(graft(crossref_3.ListA)))
num_36 = Number(simplify(graft(crossref_3.ListB)))
num_37 = Number(simplify(graft(crossref_3.ListC)))
# LATTICE GENERATION
data_27 = Data(data_3)
data_28 = Data(data_4)
data_29 = Data(data_2)
pt_48 = ConstructPoint(XCoordinate=num_35, YCoordinate=num_36, ZCoordinate=0)
srf_12 = Surface(srf_10)
srf_13 = Surface(srf_9)
pt_49 = Point(pt_48)
evalsrf_2 = EvaluateSurface(Surface=reparameterize(srf_12), Point=pt_49)  # -> Point, Normal, UDirection, VDirection, Frame
evalsrf_3 = EvaluateSurface(Surface=reparameterize(srf_13), Point=pt_49)  # -> Point, Normal, UDirection, VDirection, Frame
pt_50 = Point(evalsrf_2.Point)
pt_51 = Point(evalsrf_3.Point)
pt_52 = Point(pt_50)
data_30 = Data(data_28)
data_31 = Data(data_27)
data_32 = Data(data_27)
pt_53 = Point(pt_51)
data_33 = Data(data_28)
cluster_6 = Cluster_3(pt=pt_52, data_2=data_32, data=data_30)
cluster_7 = Cluster_3(pt=pt_53, data_2=data_31, data=data_33)
expression = Expression(x=pt_50, y=pt_51, a=num_37, Expression="x*a + y*(1-a)")
multiplication_9 = Multiplication(A=data_27, B=data_28)
pt_54 = Point(cluster_6)
pt_55 = Point(cluster_7)
int_18 = Integer(multiplication_9)
pt_56 = Point(expression)
pt_57 = Point(pt_54)
pt_58 = Point(pt_55)

# ----
# MAKE CELLS
pt_59 = Point(flatten(pt_56))
data_34 = Data(data_27)
data_35 = Data(data_28)
data_36 = Data(data_29)
python_11 = PythonScript(x=data_34, y=data_35, z=data_36, pointlist=pt_59)  # -> out, cube; inputs pointlist: list; same code as python_4
lng = ListLength(List=python_11.cube)
int_19 = Integer(lng)
python_12 = PythonScript(x=python_11.cube)  # -> simplify(a); same code as python_5
pt_60 = Point(python_12)
item_8 = ListItem(List=pt_60, Index=0, Wrap=True)  # -> Item, Item1, Item2, Item3, Item4, Item5, Item6, Item7
tbox_2 = TwistedBox(
    CornerA=item_8.Item,
    CornerB=item_8.Item1,
    CornerC=item_8.Item2,
    CornerD=item_8.Item3,
    CornerE=item_8.Item4,
    CornerF=item_8.Item5,
    CornerG=item_8.Item6,
    CornerH=item_8.Item7)
geo_3 = Geometry(tbox_2)

# ----
# MAP UNIT CELLS
crv_37 = Curve(crv_9)
group_2 = Group(Objects=crv_37)
# LOOK AT ME
num_38 = Number(num_2)
cluster_8 = Cluster_4(crv=crv_37, ldist=num_38)
crv_38 = Curve(cluster_8)
data_37 = Data(data_34)
data_38 = Data(data_35)
box_7 = Box(group_2)
crv_39 = Curve(crv_38)
multiplication_10 = Multiplication(A=data_37, B=data_38)
morph_2 = BoxMorph(Geometry=crv_39, Reference=box_7, Target=geo_3)  # -> simplify(Geometry)
data_39 = Data(multiplication_10)
series_12 = Series(Start=data_38, Step=1, Count=data_39)
branch_3 = TreeBranch(Tree=morph_2, Path=series_12, MaintainPaths=True)
crv_40 = Curve(morph_2)
crv_41 = Curve(flatten(crv_40))
crv_42 = Curve(branch_3)

# ----
# VISUALIZATION
curve_2 = Curve(crv_41)
geometry_4 = Geometry(multipipe)

# ---- group: Generation of Exoskeleton (Unit Cells) (continued)
curve_3 = Curve(crv_41)
multipipe_2 = MultiPipe(
    Curves=curve_3,
    NodeSize=Slider(0.001, range=0..1),
    EndOffset=1,
    StrutSize=Slider(0.005, range=0..1),
    Segment=0,
    KinkAngle=0.6,
    CubeFit=0,
    Caps=Slider(0, range=0..2))  # disabled

# ----
# INPUTS/VARIABLES
# UNIT CELL TOPOLOGIES
item_9 = ListItem(List=viewer, Index=unit_cell_types, Wrap=True)
geometry_5 = Geometry(multipipe_2)  # disabled

# ---- group: Top Srf Boundary
surface = Surface(srf_13)
boundary = BoundarySurfaces(Edges=surface)  # -> flatten(Surfaces)
join = BrepJoin(Breps=boundary)  # -> Breps, Closed
brep = Brep(join.Breps)
mesh_15 = Mesh(brep)
wbjoin_2 = WeaverbirdsJoinMeshesAndWeld(Mesh=mesh_15, Weld=False)
medges = MeshEdges(Mesh=wbjoin_2)  # -> NakedEdges, InteriorEdges, NonManifoldEdges
join_2 = JoinCurves(Curves=medges.NakedEdges, Preserve=False)
crv_43 = Curve(join_2)

# ---- group: Bottom Srf Boundary
surface_2 = Surface(srf_12)
boundary_2 = BoundarySurfaces(Edges=surface_2)  # -> flatten(Surfaces)
join_3 = BrepJoin(Breps=boundary_2)  # -> Breps, Closed
brep_2 = Brep(join_3.Breps)
mesh_16 = Mesh(brep_2)
wbjoin_3 = WeaverbirdsJoinMeshesAndWeld(Mesh=mesh_16, Weld=False)
medges_2 = MeshEdges(Mesh=wbjoin_3)  # -> NakedEdges, InteriorEdges, NonManifoldEdges
join_4 = JoinCurves(Curves=medges_2.NakedEdges, Preserve=False)
crv_44 = Curve(join_4)

# ---- group: Bottom Lattice Boundary
pt_61 = Point(pt_60)
int_20 = Integer(int_18)
series_13 = Series(Start=0, Step=1, Count=int_20)
branch_4 = TreeBranch(Tree=pt_61, Path=series_13, MaintainPaths=True)
item_10 = ListItem(List=branch_4, Index=0, Wrap=True)  # -> Item, Item1, Item2, Item3, Item4, Item5, Item6, Item7
merge_11 = Merge(Data1=item_10.Item, Data2=item_10.Item1, Data3=item_10.Item2, Data4=item_10.Item3)
merge_12 = Merge(Data1=item_10.Item, Data2=item_10.Item1, Data3=item_10.Item2, Data4=item_10.Item3)  # -> simplify(graft(Result))
merge_13 = Merge(Data1=item_10.Item1, Data2=item_10.Item2, Data3=item_10.Item3, Data4=item_10.Item)  # -> simplify(graft(Result))
lng_2 = ListLength(List=merge_11)
avr_2 = Average(Input=merge_11)
ln_7 = Line(StartPoint=merge_12, EndPoint=merge_13)
pt_62 = Point(avr_2)
repeat = RepeatData(Data=pt_62, Length=lng_2)  # -> simplify(graft(Data))
pt_63 = Point(repeat)
ln_8 = Line(StartPoint=pt_63, EndPoint=merge_12)
ln_9 = Line(StartPoint=merge_13, EndPoint=pt_63)
merge_14 = Merge(Data1=ln_8, Data2=ln_7, Data3=ln_9)

scale_3 = Scale(Geometry=merge_14, Center=Point(0, 0, 0), Factor="1000")  # -> Geometry, Transform
wbweave = WeaverbirdsMeshFromLinesWeaveBack(Lines=scale_3.Geometry, MaximumValence=4)
mesh_17 = Mesh(flatten(wbweave))
wbjoin_4 = WeaverbirdsJoinMeshesAndWeld(Mesh=mesh_17, Weld=False)
medges_3 = MeshEdges(Mesh=wbjoin_4)  # -> NakedEdges, InteriorEdges, NonManifoldEdges
join_5 = JoinCurves(Curves=medges_3.NakedEdges, Preserve=False)
scale_4 = Scale(Geometry=join_5, Center=Point(0, 0, 0), Factor=expr("1/x", "1000"))  # -> Geometry, Transform
crv_45 = Curve(scale_4.Geometry)

# ----
# OPT3: EDGE COUNT
curve_4 = Curve(crv_41)
list_length = ListLength(List=curve_4)
panel_17 = Panel(list_length)
larger_than = LargerThan(FirstNumber=list_length, SecondNumber=panel_17)  # -> LargerThan, OrEqualTo
panel_18 = Panel(larger_than.OrEqualTo)

number_4 = Number(flatten(list_length))

# ---- group: Bottom Lattice Boundary
panel_19 = Panel(merge_14)

# ----
crv_46 = Curve(crv_45)
area = Area(Geometry=crv_44)  # -> Area, Centroid
area_2 = Area(Geometry=crv_46)  # -> Area, Centroid
subtraction_6 = Subtraction(A=area.Area, B=area_2.Area)
area_bottom = Panel(subtraction_6)

# ---- group: Top Lattice Boundary
pt_64 = Point(pt_60)
int_21 = Integer(int_18)
series_14 = Series(Start=0, Step=1, Count=int_21)
branch_5 = TreeBranch(Tree=pt_64, Path=series_14, MaintainPaths=True)
item_11 = ListItem(List=branch_5, Index=0, Wrap=True)  # -> Item, Item1, Item2, Item3, Item4, Item5, Item6, Item7
merge_15 = Merge(Data1=item_11.Item, Data2=item_11.Item1, Data3=item_11.Item2, Data4=item_11.Item3)
merge_16 = Merge(Data1=item_11.Item, Data2=item_11.Item1, Data3=item_11.Item2, Data4=item_11.Item3)  # -> simplify(graft(Result))
merge_17 = Merge(Data1=item_11.Item1, Data2=item_11.Item2, Data3=item_11.Item3, Data4=item_11.Item)  # -> simplify(graft(Result))
lng_3 = ListLength(List=merge_15)
avr_3 = Average(Input=merge_15)
pt_65 = Point(avr_3)
repeat_2 = RepeatData(Data=pt_65, Length=lng_3)  # -> simplify(graft(Data))
ln_10 = Line(StartPoint=merge_16, EndPoint=merge_17)
pt_66 = Point(repeat_2)

# scaling up due to
# small numbers tolerance issues
panel_20 = Panel("1000")

# ---- group: Optimization of length of lines
# OPT1: LINE LENGTH
panel_21 = Panel("0.03")
galapagos_2 = Galapagos(
    fitness=number_6,
    gene=[number_slider, number_slider_2, number_slider_11, number_slider_6, number_slider_7, number_slider_8, number_slider_10, number_slider_9, number_slider_12, number_slider_13, number_slider_14, number_slider_4, number_slider_5, number_slider_3])

# ----
# OPT2: AREA DIFFERENCE
project_12 = Project(Geometry=crv_43, Plane=PlaneXY(0, 0, 0))  # -> Geometry, Transform
area_3 = Area(Geometry=project_12.Geometry)  # -> Area, Centroid

# ----
# GEOMETRY/FABRICATION OPTIMIZATION
number_slider_23 = Slider(0, range=0..100)
deconstruct = Deconstruct(Point=pt_66)  # -> XComponent, YComponent, ZComponent
construct_point = ConstructPoint(XCoordinate=deconstruct.XComponent, YCoordinate=deconstruct.YComponent, ZCoordinate=number_slider_23)
point = Point(construct_point)
boolean = Boolean(larger_than.OrEqualTo)

# ---- group: Top Lattice Boundary (continued)
ln_11 = Line(StartPoint=point, EndPoint=merge_16)
ln_12 = Line(StartPoint=merge_17, EndPoint=point)
merge_18 = Merge(Data1=ln_11, Data2=ln_10, Data3=ln_12)

scale_5 = Scale(Geometry=merge_18, Center=Point(0, 0, 0), Factor=panel_20)  # -> Geometry, Transform
wbweave_2 = WeaverbirdsMeshFromLinesWeaveBack(Lines=scale_5.Geometry, MaximumValence=4)
mesh_18 = Mesh(flatten(wbweave_2))
wbjoin_5 = WeaverbirdsJoinMeshesAndWeld(Mesh=mesh_18, Weld=False)
medges_4 = MeshEdges(Mesh=wbjoin_5)  # -> NakedEdges, InteriorEdges, NonManifoldEdges
join_6 = JoinCurves(Curves=medges_4.NakedEdges, Preserve=False)
scale_6 = Scale(Geometry=join_6, Center=Point(0, 0, 0), Factor=expr("1/x", panel_20))  # -> Geometry, Transform
crv_47 = Curve(scale_6.Geometry)

panel_22 = Panel(merge_18)

# ----
crv_48 = Curve(crv_47)
project_13 = Project(Geometry=crv_48, Plane=PlaneXY(0, 0, 0))  # -> Geometry, Transform
area_4 = Area(Geometry=project_13.Geometry)  # -> Area, Centroid
subtraction_7 = Subtraction(A=area_3.Area, B=area_4.Area)
absolute = Absolute(Value=subtraction_7)
division_11 = Division(A=absolute, B=area_3.Area)
larger_than_2 = LargerThan(FirstNumber=division_11, SecondNumber="0.1")  # -> LargerThan, OrEqualTo
area_top = Panel(division_11)
area_top_2 = Panel(larger_than_2.OrEqualTo)

boolean_2 = Boolean(larger_than_2.OrEqualTo)
gate_and = GateAnd(A=boolean_2, B=boolean)
multiplication_11 = Multiplication(A=gate_and, B="1000000000")
addition_4 = Addition(A=multiplication_11)
number_5 = Number(addition_4)

panel_23 = Panel(number_5)

galapagos_3 = Galapagos()

crv_49 = Curve(flatten(crv_42))
crv_50 = Curve(crv_49)
num_39 = Number(num_2)
cluster_9 = Cluster_2(crv=crv_50, num=num_39)
pt_67 = Point(cluster_9)
pt_68 = Point(pt_30)
pt_69 = Point(pt_68)
srf_14 = Surface(srf_9)
srf_15 = Surface(srf_9)
pt_70 = Point(pt_67)
G_4 = Geometry(srf_14)
G_5 = Geometry(srf_15)
project_14 = ProjectPoint(Point=pt_69, Direction=Vector(0, 0, -1), Geometry=G_4)  # -> Point, Index
project_15 = ProjectPoint(Point=pt_70, Direction=Vector(0, 0, -1), Geometry=G_5)  # -> Point, Index
pt_71 = Point(project_14.Point)
pt_72 = Point(project_15.Point)
pt_73 = Point(pt_71)
pt_74 = Point(pt_72)
num_40 = Number(num)
A = PointA(pt_68)
B = PointB(pt_73)
A_2 = PointA(pt_70)
B_2 = PointB(pt_74)
pt_75 = Point(flatten(pt_10))
pt_76 = Point(flatten(pt_68))
pt_77 = Point(flatten(pt_35))
dist_2 = Distance(PointA=A, PointB=B)
merge_19 = Merge(Data1=pt_75, Data2=pt_76, Data3=pt_77)
num_41 = Number(num_2)
dist_3 = Distance(PointA=A_2, PointB=B_2)
num_42 = Number(num)
num_43 = Number(dist_2)
num_44 = Number(dist_3)
panel_24 = Panel(num_43)
smaller_4 = SmallerThan(FirstNumber=num_43, SecondNumber=num_42)  # -> SmallerThan, OrEqualTo
smaller_5 = SmallerThan(FirstNumber=num_44, SecondNumber=num_40)  # -> SmallerThan, OrEqualTo
rdpoints_2 = RemoveDuplicatePointsKaramba3D(Point=merge_19, LimitDistance=num_41)  # -> OutPoint, Info, Indexes
dispatch_10 = Dispatch(List=A, DispatchPattern=smaller_4.SmallerThan)  # -> ListA, ListB
dispatch_11 = Dispatch(List=B, DispatchPattern=smaller_4.SmallerThan)  # -> ListA, ListB
dispatch_12 = Dispatch(List=A_2, DispatchPattern=smaller_5.SmallerThan)  # -> ListA, ListB
dispatch_13 = Dispatch(List=pt_74, DispatchPattern=smaller_5.SmallerThan)  # -> ListA, ListB
num_45 = Number("1000")
A_3 = PointA(dispatch_11.ListA)
A_4 = PointA(dispatch_10.ListA)
A_5 = PointA(dispatch_13.ListA)
A_6 = PointA(dispatch_12.ListA)
ln_13 = Line(StartPoint=A_4, EndPoint=A_3)
ln_14 = Line(StartPoint=A_6, EndPoint=A_5)
A_7 = PointA(A_4)
crv_51 = Curve(ln_13)
crv_52 = Curve(ln_14)
A_8 = PointA(A_5)

# ----
# Shoe Shell
A_9 = PointA(flatten(A_8))
pt_78 = Point(flatten(pt_58))
pt_79 = Point(flatten(pt_73))
pt_80 = Point(pt_57)
srf_16 = Surface(srf_10)
num_46 = Number(num_4)
int_22 = Integer(int)
srf_17 = Surface(srf_9)
num_47 = Number(num_4)
int_23 = Integer(int)
merge_20 = Merge(Data1=pt_80)
merge_21 = Merge(Data1=pt_79, Data2=pt_78, Data3=A_9)
pt_81 = Point(merge_20)
pt_82 = Point(merge_21)
mesh_breps_2 = MeshBrepsKaramba3D(
    Brep=srf_16,
    InclusionPoints=pt_81,
    MeshResolution=num_46,
    EdgeRefinementFactor=0.67,
    PointReduction=False,
    SmoothingStepSize=0,
    SmoothingIterations=int_22)  # -> Mesh, Info
mesh_breps_3 = MeshBrepsKaramba3D(
    Brep=srf_17,
    InclusionPoints=pt_82,
    MeshResolution=num_47,
    EdgeRefinementFactor=0.67,
    PointReduction=False,
    SmoothingStepSize=0,
    SmoothingIterations=int_23)  # -> Mesh, Info
num_48 = Number(num_2)
mesh_19 = Mesh(mesh_breps_3.Mesh)
mesh_20 = Mesh(mesh_breps_2.Mesh)
num_49 = Number(num_2)
weldvertices = MeshWeldVertices(Mesh=mesh_19, Tolerance=num_48)  # -> RuntimeMessage, Mesh
weldvertices_2 = MeshWeldVertices(Mesh=mesh_20, Tolerance=num_49)  # -> RuntimeMessage, Mesh
mesh_21 = Mesh(weldvertices.Mesh)
mesh_22 = Mesh(weldvertices_2.Mesh)
mesh_23 = Mesh(mesh_21)

# ----
# Interfaces
# Feet
# Supports
pt_83 = Point(pt_57)
crv_53 = Curve(crv_32)
crv_54 = Curve(crv_51)

# ---- group: deal with tolerance issue
scale_7 = Scale(Geometry=rdpoints_2.OutPoint, Center=Point(0, 0, 0), Factor=num_45)  # -> Geometry, Transform
del = DelaunayMesh(Points=scale_7.Geometry, Plane=PlaneXY(0, 0, 0))
scale_8 = Scale(Geometry=del, Center=Point(0, 0, 0), Factor=expr("1/x", num_45))  # -> Geometry, Transform
mesh_24 = Mesh(scale_8.Geometry)

# ----
mesh_25 = Mesh(mesh_24)

# ----
# SUPPORTS
pt_84 = Point(flatten(pt_83))
pt_85 = Point(pt_84)
item_12 = ListItem(List=pt_85, Index=0, Wrap=True)  # -> Item, Item1, Item2
supp = SupportKaramba3D(PosInd=pt_85, menu=[buttons(off, off, on, off, off, off)])
supp_2 = SupportKaramba3D(PosInd=[item_12.Item, item_12.Item1, item_12.Item2], menu=[buttons(on, on, off, on, on, on)])
merge_22 = Merge(Data1=supp, Data2=supp_2)

# ----
# FEET SHELL
number_slider_24 = Slider(0.5, range=0..1)
mesh_26 = Mesh(mesh_25)
mesh_27 = Mesh(mesh_26)
num_50 = Number(number_slider_24)
cross_section = CrossSectionKaramba3D(FamilyNameOfCrossSection="DefaultCroSec", Height_cm=num_50, mode="Shell - Const")
mesh_28 = Mesh(flatten(mesh_27))
txt = Text("feet_shell")
txt_2 = Text(txt)
ldist = LimitDistanceM(num_2)
meshtoshell = MeshToShellKaramba3D(Mesh=mesh_28, Identifier=txt_2, CrossSection=cross_section, LimitDistance_m=ldist)  # -> Element, Points, Info

# ----
# FEET LATTICE
medges_5 = MeshEdges(Mesh=mesh_28)  # -> NakedEdges, InteriorEdges, NonManifoldEdges
crv_55 = Curve(flatten([medges_5.NakedEdges, medges_5.InteriorEdges]))
crv_56 = Curve(medges_5.InteriorEdges)
txt_3 = Text("feet_lattice")
crv_57 = Curve(flatten(crv_53))
crv_58 = Curve(flatten(crv_55))
txt_4 = Text(txt_3)
ldist_2 = LimitDistanceM(num_2)
ldist_3 = LimitDistanceM(num_2)
linetobeam = LineToBeamKaramba3D(
    Line=flatten([crv_57, crv_58]),
    Identifier=txt_4,
    New=True,
    Remove=True,
    LimitDistance_m=ldist_2,
    Bending=True,
    SetBucklingLength=True,
    ToPolylineMaxAngle=0.03,
    ToPolylineTolerance=0.01,
    ToPolylineMaxEdgeLength=0.25)  # -> Element, Points, Info
assemble = AssembleModelKaramba3D(Elem=linetobeam.Element, LimitDistance_m=ldist_3)  # -> Model, Info, Mass_kg, CenterOfGravity, LoadCaseNames
conparts = ConnectedPartsKaramba3D(Model=assemble.Model)  # -> simplify(ConnectedLines), ConnectedMeshes
branch_6 = TreeBranch(Tree=conparts.ConnectedLines, Path="0", MaintainPaths=True)
linetobeam_2 = LineToBeamKaramba3D(
    Line=branch_6,
    Identifier=txt_4,
    New=True,
    Remove=True,
    LimitDistance_m=ldist_2,
    Bending=True,
    SetBucklingLength=True,
    ToPolylineMaxAngle=0.03,
    ToPolylineTolerance=0.01,
    ToPolylineMaxEdgeLength=0.25)  # -> Element, Points, Info
element = ElementKaramba3D(linetobeam_2.Element)
element_2 = ElementKaramba3D(element)

# ----
# FEET-SHOE INTERFACE
panel_25 = Panel("interface")
crv_59 = Curve(flatten(crv_54))
txt_5 = Text(panel_25)
ldist_4 = LimitDistanceM(num_2)
txt_6 = Text(txt_5)
linetobeam_3 = LineToBeamKaramba3D(
    Line=crv_59,
    Identifier=txt_6,
    New=True,
    Remove=True,
    LimitDistance_m=ldist_4,
    Bending=Toggle(False),
    SetBucklingLength=True,
    ToPolylineMaxAngle=0.03,
    ToPolylineTolerance=0.01,
    ToPolylineMaxEdgeLength=0.25)  # -> Element, Points, Info

number_slider_25 = Slider(0.1, range=0..0.1)
vec_5 = VectorXYZ(XComponent=number_slider_25, YComponent=number_slider_25, ZComponent=Slider(10, range=0..10))  # -> Vector, Length
beam_joints = BeamJointsKaramba3D(
    CtKNMAtStartingNode=Vector(0, 0, 0),
    CrKNmRadAtStartingNode=Vector(0, 0, 0),
    CtKNMAtEndNode=vec_5.Vector,
    CrKNmRadAtEndNode=Vector(0, 0, 0),
    menu=[buttons(off, off, off, off, off, off), buttons(on, on, on, off, off, off)])
modifyelem = ModifyElementKaramba3D(Beam=linetobeam_3.Element, Joint=beam_joints, mode="Beam")

# ----
# Save?
# Connect to a CSV file streamer
#   (e.g. for a new column 'image_path')
# Connect to a slider that will
#    change as designs are changing...
#    (e.g. animate slider)
file_name_prefix = Panel("line length")
folder_path = Panel("C:\Users\glady\Desktop\datalogging (new)")
bool = Boolean(Toggle(False))
bool_2 = Boolean(bool)
concat = Concatenate(FragmentA=folder_path, FragmentB="/", FragmentC=file_name_prefix)
reset = Button()

recgrid = Rectangular(Plane=PlaneXY(0, 0, 0), SizeX="220", SizeY="60", ExtentX="16", ExtentY="16")  # -> Cells, Points
boundary_3 = BoundarySurfaces(Edges=recgrid.Cells)
srf_18 = Surface(flatten(boundary_3))
wheel = ColourWheel(
    Slider(9, range=0..10),
    ColourGrips_Style=10,
    ColourGrips_Grip=[5.887290253, 5.529086092, 1.340295887, 0.2930983361],
    ColourGrips_Lum=[0.1, 0.2805227336],
    ColourGrips_Range=[1.00796592, 1.00796592, 1.00796592, 1.00796592],
    ColourGrips_Sat=[0.3524674283, 0.6])
lng_4 = ListLength(List=srf_18)
repeat_3 = RepeatData(Data=wheel, Length=lng_4)
jitter = Jitter(List=repeat_3, Jitter=1, Seed=Slider(31, range=0..50))  # -> Values, Indices
preview = CustomPreview(Geometry=srf_18, Material=jitter.Values)

# ----
# VISUALIZATION
curve_5 = Curve(crv_41)

# ---- group: Exoskeleton (Sole Lattice)
geometry_6 = Geometry(curve_5)
curve_6 = Curve(geometry_6)
multipipe_3 = MultiPipe(
    Curves=curve_6,
    NodeSize=Slider(0.001, range=0..1),
    EndOffset=1,
    StrutSize=Slider(0.8, range=0..1),
    Segment=0,
    KinkAngle=0.6,
    CubeFit=0,
    Caps=Slider(1, range=0..2))

# ----
geometry_7 = Geometry(multipipe_3)

move_11 = Move(Geometry=geometry_7, Motion=unit_y)  # -> Geometry, Transform
geometry_8 = Geometry(move_11.Geometry)
custom_preview = CustomPreview(Geometry=geometry_8, Material=ColourSwatch(SwatchColor=RGB(253, 253, 253)))

# ----
# ANALYSING DESIGNS
# plastic material volume budgeted for sole lattice
crv_60 = Curve(crv_41)
crv_61 = Curve(crv_60)
crv_62 = Curve(crv_61)
num_51 = Number("1")
len = Length(Curve=crv_62)
num_52 = Number(len)
ma_8 = MassAddition(Input=num_52)  # -> Result, PartialResults
num_53 = Number(ma_8.Result)
division_12 = Division(A=num_51, B=num_53)
expression_2 = Expression(area=division_12, Expression="(area/π)^½")
matselect = MaterialSelectionKaramba3D(menu=[dropdown(0), dropdown(0)])
num_54 = Number(expression_2)
thickness = WallThicknessCm(num_54)
thickness_2 = WallThicknessCm(thickness)
diameter = DiameterCm(thickness)
crv_63 = Curve(flatten(crv_61))
txt_7 = Text("sole_lattice")

# ---- group: Optimization of length of lines (continued)
len_2 = Length(Curve=crv_61)
larger_4 = LargerThan(FirstNumber=len_2, SecondNumber=panel_21)  # -> LargerThan, OrEqualTo
smaller_6 = SmallerThan(FirstNumber=len_2, SecondNumber="0.005")  # -> SmallerThan, OrEqualTo
or = GateOr(A=larger_4.LargerThan, B=smaller_6.SmallerThan)
dispatch_14 = Dispatch(List=crv_61, DispatchPattern=or)  # -> ListA, ListB
ma_9 = MassAddition(Input=or)  # -> Result, PartialResults
crv_64 = Curve(dispatch_14.ListA)
num_55 = Number(ma_9.Result)
num_56 = Number(num_55)
panel_26 = Panel(num_55)
merge_23 = Merge(Data1=num_56, Data2="1000000")
null_7 = NullItem(Item=num_56)  # -> NullFlags, InvalidFlags, Description
item_13 = ListItem(List=merge_23, Index=null_7.NullFlags, Wrap=True)
num_57 = Number(item_13)

# ----
panel_27 = Panel(num_57)

int_24 = Integer(num_57)
data_40 = Data(flatten(int_24))
item_14 = ListItem(List=data_40, Index=0, Wrap=True)
c_name_iterator = CSharpScript(port=item_14, T=bool_2, R=reset, P=concat)  # -> out, A; inputs T: Boolean, R: Boolean
# ---------- c_name_iterator: C# ----------
    if(T)
    {
      n++;
    }
    if(R)
    {
      n = 0;
    }
    A = P + "_" + n + ".jpg";
# ---------- c_name_iterator: C# additional code ----------
  public int n;
# ---------- end c_name_iterator ----------
c_vp_to_img = CSharpScript(T=bool_2, P=c_name_iterator.A)  # inputs T: Boolean, P: String
# ---------- c_vp_to_img: C# ----------
    if(T)
    {
      var file_name = "";
      if (P != "")
      {
        file_name = P;
        var bitmap = RhinoDoc.ActiveDoc.Views.ActiveView.CaptureToBitmap(false, false, false);
        //Clipboard.SetImage(bitmap);
        bitmap.Save(file_name);
      }
    }
# ---------- end c_vp_to_img ----------
txt_8 = Text(c_name_iterator.A)
full_saved_image_path = Panel(txt_8)

number_slider_26 = Slider(1.4, range=0..10)
material_properties_karamba3d = MaterialPropertiesKaramba3D(
    FamilyOfMaterial="Steel",
    Name="S235",
    YoungsModulus_kN_cm2=number_slider_26,
    InPlaneShearModulus_kN_cm2=expr("x/2.5", number_slider_26),
    TransverseShearModulus_kN_cm2=expr("x/2.5", number_slider_26),
    SpecificWeight_kN_m3=Slider(1.08, range=0..10),
    CoefficientOfThermalExpansion_1_C=1.2e-05,
    TensileStrength_kN_cm2=Slider(82, range=0..100),
    CompressiveStrength_kN_cm2=Slider(2.06, range=0..10),
    StrengthHypothesis="MISES",
    mode="Isotrop")
material_karamba3d = MaterialKaramba3D(material_properties_karamba3d)

material_karamba3d_2 = MaterialKaramba3D(material_karamba3d)
cross_section_2 = CrossSectionKaramba3D(
    FamilyNameOfCrossSection="DefaultCroSec",
    Material=material_karamba3d_2,
    Diameter_cm=expr("x*2", diameter),
    WallThickness_cm=thickness_2,
    mode="Circular Hollow")
crosec = CrossSection(cross_section_2)

# ----
# SOLE TOP / BOTTOM
number_slider_27 = Slider(0.25, range=0..1)
material_karamba3d_3 = MaterialKaramba3D(material_karamba3d)
num_58 = Number(number_slider_27)
cross_section_3 = CrossSectionKaramba3D(FamilyNameOfCrossSection="DefaultCroSec", Material=material_karamba3d_3, Height_cm=num_58, mode="Shell - Const")
mesh_29 = Mesh(mesh_23)
mesh_30 = Mesh(flatten(mesh_22))
txt_9 = Text("sole_shell_bottom")
mesh_31 = Mesh(flatten(mesh_29))
txt_10 = Text("sole_shell_top")
txt_11 = Text(txt_9)
ldist_5 = LimitDistanceM(num_2)
txt_12 = Text(txt_10)
ldist_6 = LimitDistanceM(num_2)
meshtoshell_2 = MeshToShellKaramba3D(Mesh=mesh_30, Identifier=txt_11, CrossSection=cross_section_3, LimitDistance_m=ldist_5)  # -> Element, Points, Info
# LOOK AT ME
meshtoshell_3 = MeshToShellKaramba3D(Mesh=mesh_31, Identifier=txt_12, CrossSection=cross_section_3, LimitDistance_m=ldist_6)  # -> Element, Points, Info

# ----
# SOLE LATTICE
ldist_7 = LimitDistanceM(num_2)
txt_13 = Text(txt_7)
linetobeam_4 = LineToBeamKaramba3D(
    Line=crv_63,
    Identifier=txt_13,
    CrossSection=crosec,
    New=True,
    Remove=True,
    LimitDistance_m=ldist_7,
    Bending=True,
    SetBucklingLength=True,
    ToPolylineMaxAngle=0.03,
    ToPolylineTolerance=0.01,
    ToPolylineMaxEdgeLength=0.25)  # -> Element, Points, Info
modifyelem_2 = ModifyElementKaramba3D(Beam=linetobeam_4.Element, mode="Beam")

merge_24 = Merge(
    Data1=modifyelem_2,
    Data2=modifyelem,
    Data3=meshtoshell_3.Element,
    Data4=meshtoshell_2.Element,
    Data5=element_2,
    Data6=meshtoshell.Element)  # -> flatten(Result)
load_2 = Load(load)
ldist_8 = LimitDistanceM(num_2)
assemble_2 = AssembleModelKaramba3D(Elem=merge_24, Support=merge_22, Load=load_2, LimitDistance_m=ldist_8)  # -> Model, Info, Mass_kg, CenterOfGravity, LoadCaseNames
panel_28 = Panel(assemble_2.Model)
analyze = AnalyzeKaramba3D(Model=assemble_2.Model)  # -> CalculatedModel, MaximumDisplacement_cm, ResultingForceOfGravity_kN, ElasticEnergyChange_kNm
panel_29 = Panel(analyze.MaximumDisplacement_cm)
model = ModelKaramba3D(analyze.CalculatedModel)
txt_14 = Text(txt_5)
model_2 = ModelKaramba3D(model)
model_3 = ModelKaramba3D(model)
series_15 = Series(Start=0, Step=1, Count=10)
division_13 = Division(A=series_15, B=Slider(10, range=0..10))
tencomelim = TensionCompressionEliminatorKaramba3D(Model=model_2, MaximumIterations=20, BeamIdentifiers=txt_14, LoadCaseToConsider="0", CompressionElementsOnly=True)  # -> MaximumDisplacement, OptimizedModel, ElementIsActive; disabled
analyze_2 = AnalyzeKaramba3D(Model=tencomelim.OptimizedModel)  # -> CalculatedModel, MaximumDisplacement_cm, ResultingForceOfGravity_kN, ElasticEnergyChange_kNm; disabled
gradient = Gradient(LowerLimit=0, UpperLimit=1, Parameter=division_13, stops=[0: RGB(255, 255, 255), 1: RGB(0, 0, 0)])
model_4 = ModelKaramba3D(model_3)
model_6 = AnalyzedModel(model_4)
pos_inds = PositionsIndexes()
modelview = ModelViewKaramba3D(Model=model_4, ResultFactors=1, ResultCase=-1, Colors=gradient)  # -> Model, DeformedMesh, DeformedAxes, DeformedModel
b_forces = BeamForcesKaramba3D(AnalyzedModel=model_4, Ts=[0, 1])  # -> AnalyzedModel, simplify(NormalForce_kN), ShearForceVz_kN, ShearForceVy_kN, TorsionalMomentMt_kNm, BendingMomentMy_kNm, BendingMomentMz_kNm
nodedisp = NodalDisplacementsKaramba3D(AnalyzedModel=model_6, PositionsIndexes=pos_inds)  # -> AnalyzedModel, NodalTranslations_m, NodalRotations_rad
model_7 = ModelKaramba3D(b_forces.AnalyzedModel)
model_8 = ModelKaramba3D(modelview.Model)

model_9 = ModelKaramba3D(model_8)
txt_15 = Text(txt_5)
txt_16 = Text(txt_3)
model_10 = ModelKaramba3D(model_7)
txt_17 = Text(txt_15)
model_11 = ModelKaramba3D(model_10)
txt_18 = Text(txt_17)
model_12 = AnalyzedModel(model_10)
b_forces_2 = BeamForcesKaramba3D(AnalyzedModel=model_12, BeamsIdentifiers=txt_18, Ts=[0, 1])  # -> AnalyzedModel, simplify(NormalForce_kN), ShearForceVz_kN, ShearForceVy_kN, TorsionalMomentMt_kNm, BendingMomentMy_kNm, BendingMomentMz_kNm
disassemble = DisassembleModelKaramba3D(Model=model_11)  # -> Model, Point, Beam, Shell, Support, Load, Line, Mesh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
beamdisp = BeamDisplacementsKaramba3D(AnalyzedModel=model_12, BeamsIdentifiers=txt_18, Ts=[0, 1])  # -> AnalyzedModel, simplify(Translations_m), Rotations_rad
ids = ElementIdentifiers(txt_17)
num_59 = Number(b_forces_2.NormalForce_kN)
dispatch_elements = DispatchElementsFromListOfElementsKaramba3D(Elements=disassemble.Beam, ElementIdentifiers=ids)  # -> SelectedElements, RejectedElements
pdecon_8 = Deconstruct(Point=beamdisp.Translations_m)  # -> XComponent, YComponent, ZComponent
avr_4 = Average(Input=num_59)
abs_3 = Absolute(Value=num_59)
data_41 = Data(dispatch_elements.SelectedElements)
sort = SortList(Keys=flatten(abs_3))  # -> Keys, ValuesA
num_60 = Number(pdecon_8.ZComponent)
num_61 = Number(avr_4)
avr_5 = Average(Input=num_60)
disassemble_2 = DisassembleElementKaramba3D(Element=data_41)  # -> Element, ElementIdentifier, AxisOfElement, CrossSection, Joint, Material, LocalCoordinateSystem, ElementIsActive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
item_15 = ListItem(List=sort.Keys, Index=0, Wrap=True)  # -> Item1, Item
abs_4 = Absolute(Value=avr_5)
crv_65 = Curve(disassemble_2.AxisOfElement)
data_42 = Data(item_15.Item1)
neg_9 = Negative(Value=data_42)
gradient_2 = Gradient(
    LowerLimit="0",
    UpperLimit="0.01",
    Parameter=abs_4,
    stops=[0: RGB(255, 255, 255), 0.503: RGB(0, 0, 0), 1: RGB(105, 30, 235)])
model_13 = ModelKaramba3D(model_11)
txt_19 = Text(txt_17)
gradient_3 = Gradient(
    LowerLimit=neg_9,
    UpperLimit=data_42,
    Parameter=num_61,
    stops=[0: RGB(234, 38, 0), 0.25: RGB(234, 126, 0), 0.5: RGB(254, 244, 84), 0.742: RGB(173, 203, 249), 1: RGB(75, 107, 169)])
utilization = UtilizationOfElementsKaramba3D(
    AnalyzedModel=model_13,
    ElementsIdentifiers=txt_19,
    NumberOfSamplePoints=3,
    ElasticDesign=True,
    GammaM0=1,
    GammaM1=1.1,
    SwayFrame=True,
    WithDetails=False,
    mode="Beams")  # -> AnalyzedModel, Utilization, SigMax_kN_cm2, SigMin_kN_cm2, TauMax_kN_cm2, UtilN, UtilVy, UtilVz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
smaller_7 = SmallerThan(FirstNumber=num_61, SecondNumber="0.00003")  # -> SmallerThan, OrEqualTo
crv_66 = Curve(crv_65)
col = Colour(gradient_2)
sort_2 = SortList(Keys=utilization.Utilization)  # -> Keys, ValuesA
col_2 = Colour(gradient_3)
number_slider_28 = Slider(10, range=0..10)
dispatch_15 = Dispatch(List=col, DispatchPattern=smaller_7.SmallerThan)  # -> ListA, ListB
dispatch_16 = Dispatch(List=crv_66, DispatchPattern=smaller_7.SmallerThan)  # -> ListA, ListB
dispatch_17 = Dispatch(List=col_2, DispatchPattern=smaller_7.SmallerThan)  # -> ListA, ListB
dom_6 = ConstructDomain(DomainStart=Slider(1, range=0..10), DomainEnd=Slider(20, range=0..100))
dom_7 = ConstructDomain(DomainStart=0, DomainEnd=Slider(0.25, range=0..1))
remap = RemapNumbers(Value=utilization.Utilization, Source=dom_7, Target=dom_6)  # -> Mapped, Clipped
model_14 = ModelKaramba3D(model_11)
txt_20 = Text(txt)
data_43 = Data(gradient)
previewlw = CustomPreviewLineweights(Geometry=dispatch_16.ListA, Shader=dispatch_17.ListA, Thickness=Slider(27, range=0..100), Absolute=False)
previewlw_2 = CustomPreviewLineweights(Geometry=dispatch_16.ListA, Shader=dispatch_15.ListA, Thickness=Slider(27, range=0..100), Absolute=False)

# ----
# EVALUATION
# Creating data labels for 'header' row...
# List of values...
# Assemble 'header' row of data table...
# Assemble 'data' of data table
# Flatten points/vectors...
model_15 = ModelKaramba3D(model)
txt_21 = Text(txt_7)
panel_30 = Panel(txt_21)
model_16 = ModelKaramba3D(model)
txt_22 = Text(txt_5)
modelview_2 = ModelViewKaramba3D(Model=model_16, ResultFactors=1, ResultCase=-1, ElementIdentifiersBreps=txt_22)  # -> Model, DeformedMesh, DeformedAxes, DeformedModel
modelview_3 = ModelViewKaramba3D(Model=model_16, ResultFactors=1, ResultCase=-1, ElementIdentifiersBreps=txt_22)  # -> Model, DeformedMesh, DeformedAxes, DeformedModel
d_energy = DeformationEnergyKaramba3D(AnalyzedModel=model_15, ElementsIdentifiers=panel_30, NIntervals=2)  # -> AnalyzedModel, AxialDeformationEnergies_kNm, BendingEnergies_kNm
model_17 = ModelKaramba3D(modelview_3.Model)
crv_67 = Curve(modelview_3.DeformedAxes)
crv_68 = Curve(modelview_2.DeformedAxes)
addition_5 = Addition(A=d_energy.AxialDeformationEnergies_kNm, B=d_energy.BendingEnergies_kNm)
end = EndPoints(Curve=crv_67)  # -> Start, End
end_2 = EndPoints(Curve=crv_68)  # -> Start, End
num_62 = Number(simplify(addition_5))
pt_86 = Point(end.Start)
A_10 = PointA(end_2.Start)
ma_10 = MassAddition(Input=flatten(num_62))  # -> Result, PartialResults
dist_4 = Distance(PointA=pt_86, PointB=A_10)
num_63 = Number(simplify(ma_10.Result))
num_64 = Number(dist_4)
num_65 = Number(num_64)
multiplication_12 = Multiplication(A=num_65, B="1000")
sort_3 = SortList(Keys=multiplication_12)  # -> reverse(flatten(Keys)), ValuesA
item_16 = ListItem(List=sort_3.Keys, Index=0, Wrap=True)
python_13 = GhPythonScript(x=multiplication_12)  # -> out, mean, variance; inputs x: list
# ---------- python_13: Python ----------
__author__ = "tamk"
__version__ = "2024.04.11"

import rhinoscriptsyntax as rs



def compute_mean_and_variance(x):
    # Calculate the sum of squared differences from the mean
    n = len(x)
    sum_ = sum(x)
    mean = sum_ / n
    squared_diff = sum((_x - mean) ** 2 for _x in x)
    # Calculate the variance
    variance = squared_diff / n
    return mean, variance

mean, variance = compute_mean_and_variance(x)
# ---------- end python_13 ----------
num_66 = Number(item_16)
num_67 = Number(python_13.variance)
num_68 = Number(python_13.mean)
num_69 = Number(num_63)
deformation_variance = Panel(num_67)
strain_energy = Panel(num_69)
deformation_average_mm = Panel(num_68)
deformation_largest_mm = Panel(num_66)
ghpython_script = GhPythonScript(label="deformation average", data=deformation_average_mm)  # -> flatten(flattened_labels); inputs data: list
# ---------- ghpython_script: Python ----------
__author__ = "tamk"
__version__ = "2024.04.04"

import rhinoscriptsyntax as rs



if label:
    flattened_labels = ["{}_{}".format(label, _i_v) for _i_v, _v in enumerate(data)]
# ---------- end ghpython_script ----------
ghpython_script_2 = GhPythonScript(label="deformation variance", data=deformation_variance)  # -> flatten(flattened_labels); inputs data: list; same code as ghpython_script
ghpython_script_3 = GhPythonScript(label="strain energy", data=strain_energy)  # -> flatten(flattened_labels); inputs data: list; same code as ghpython_script
merge_25 = Merge(Data1=num_68, Data2=num_67, Data3=num_69)  # -> flatten(Result)
panel_31 = Panel(ghpython_script)
panel_32 = Panel(ghpython_script_2)
panel_33 = Panel(ghpython_script_3)
panel_34 = Panel("""module type
density 1""")
merge_26 = Merge(Data2=panel_31, Data3=panel_32, Data5=panel_33)
merge_27 = Merge(Data2=unit_cell_types_2)
merge_28 = Merge(Data1=merge_25)
merge_29 = Merge(Data1=panel_34, Data2=merge_26)
panel_35 = Panel(merge_26)
merge_30 = Merge(Data1=merge_27, Data2=merge_28)  # -> flatten(Result)
panel_36 = Panel(merge_30)
panel_37 = Panel(merge_29)
button = Button()
ghpython_script_4 = GhPythonScript(filepath="C:\Users\glady\Desktop\data logging.csv", head=panel_35, data=panel_36, write=boolean_toggle_2)  # -> out, a; inputs head: list, data: list
# ---------- ghpython_script_4: Python ----------
__author__ = "tamk"
__version__ = "2024.04.04"

import rhinoscriptsyntax as rs
from scriptcontext import sticky
import os
import sys


if reset:
    _ = sticky.pop('filestream', {})
    
fs = sticky.setdefault('filestream', None)

if not fs and filepath and write:
    fs = sticky['filestream'] = open(filepath, 'w')
    if head:
        fs.write(','.join(str(_h) for _h in head) + '\n')
    
if fs and write:
    fs.write(','.join(str(_x) for _x in data) + '\n')
    fs.flush()

if fs and not write:
    fs.close()
    fs = sticky['filestream'] = None
# ---------- end ghpython_script_4 ----------

modelview_4 = ModelViewKaramba3D(Model=model_14, ResultFactors=1, ResultCase=-1, Colors=data_43, ElementIdentifiersBreps=txt_20)  # -> Model, DeformedMesh, DeformedAxes, DeformedModel
model_18 = ModelKaramba3D(modelview_4.Model)
shellview = ShellViewKaramba3D(Model=model_18, IndexOfLayer=0)  # -> Model, MeshesOfRenderedShells, LegendColors, LegendTags
legend = Legend(Colour=shellview.LegendColors, Tags=shellview.LegendTags, LegendType=1)

# ---- group: Text Tag 3D
list_length_2 = ListLength(List=crv_61)
division_14 = Division(A=num_57, B=list_length_2)
num_70 = Number(num_57)
panel_38 = Panel(num_70)

# ----
addition_6 = Addition(A=division_11, B=num_70)
number_6 = Number(addition_6)
panel_39 = Panel(number_6)

# ---- group: Text Tag 3D (continued)
text_tag_3d_4 = TextTag3D(Location="{0,0,0}", Text=number_6, Size=Slider(0.007, range=0..0.01), Justification=7)

# ----
# Creating data labels for 'header' row...
# Assemble 'header' row of data table...
# List of values...
# Assemble 'data' of data table
# Flatten points/vectors...
panel_40 = Panel("img")
ghpython_script_5 = GhPythonScript(label=panel_40, data=txt_8)  # -> flatten(flattened_labels); inputs data: list; same code as ghpython_script
ghpython_script_6 = GhPythonScript(label="total score", data=number_6)  # -> flatten(flattened_labels); inputs data: list; same code as ghpython_script
ghpython_script_7 = GhPythonScript(label="area difference", data=num_57)  # -> flatten(flattened_labels); inputs data: list; same code as ghpython_script
ghpython_script_8 = GhPythonScript(label="line length", data=num_57)  # -> flatten(flattened_labels); inputs data: list; same code as ghpython_script
ghpython_script_9 = GhPythonScript(label="edge count", data=number_4)  # -> flatten(flattened_labels); inputs data: list; same code as ghpython_script
ghpython_script_10 = GhPythonScript(label="module type", data=unit_cell_types_2)  # -> flatten(flattened_labels); inputs data: list; same code as ghpython_script
ghpython_script_11 = GhPythonScript(label="y", data=[data_4, number_slider_12, number_slider_13, number_slider_14])  # -> flatten(flattened_labels); inputs data: list; same code as ghpython_script
ghpython_script_12 = GhPythonScript(label="x", data=[data_3, number_slider_6, number_slider_7, number_slider_8, number_slider_9, number_slider_10])  # -> flatten(flattened_labels); inputs data: list; same code as ghpython_script
ghpython_script_13 = GhPythonScript(label="z", data=[data_2, number_slider_4, number_slider_5, number_slider_3])  # -> flatten(flattened_labels); inputs data: list; same code as ghpython_script
panel_41 = Panel(ghpython_script_8)
panel_42 = Panel(ghpython_script_5)
panel_43 = Panel(ghpython_script_6)
panel_44 = Panel(ghpython_script_7)
panel_45 = Panel(ghpython_script_12)
panel_46 = Panel(ghpython_script_9)
panel_47 = Panel(ghpython_script_10)
panel_48 = Panel(ghpython_script_13)
panel_49 = Panel(ghpython_script_11)
merge_31 = Merge(
    Data1=panel_47,
    Data2=panel_45,
    Data3=panel_49,
    Data4=panel_48,
    Data5=panel_46,
    Data6=panel_41,
    Data7=panel_44,
    Data8=panel_43,
    Data9=panel_42,
    Data10=panel_31,
    Data11=panel_32,
    Data12=panel_33)
merge_32 = Merge(
    Data1=unit_cell_types_2,
    Data2=number_slider_2,
    Data3=number_slider_6,
    Data4=number_slider_7,
    Data5=number_slider_8,
    Data6=number_slider_9,
    Data7=number_slider_10,
    Data8=number_slider_11,
    Data9=number_slider_12,
    Data10=number_slider_13,
    Data11=number_slider_14,
    Data12=number_slider,
    Data13=number_slider_4,
    Data14=number_slider_5,
    Data15=number_slider_3,
    Data16=number_4,
    Data17=num_57,
    Data18=division_11,
    Data19=number_6,
    Data20=txt_8,
    Data21=num_68,
    Data22=num_67,
    Data23=num_69)  # -> flatten(Result)
panel_50 = Panel(merge_31)
panel_51 = Panel(merge_32)
ghpython_script_14 = GhPythonScript(
    filepath="C:\Users\glady\Desktop\datalogging (new).csv",
    head=panel_50,
    data=panel_51,
    write=boolean_toggle,
    reset=Button())  # -> out, a; inputs head: list, data: list; same code as ghpython_script_4

# ==== cluster Cluster
geo = ClusterInput()
ldist = ClusterInput()
geo_2 = Geometry(geo)
ldist_2 = LimitDistance(ldist)
debrep = DeconstructBrep(Brep=geo_2)  # -> Faces, Edges, Vertices
crv = Curve(simplify(debrep.Edges))
crv_2 = Curve(flatten(crv))
rdlines = RemoveDuplicateLinesKaramba3D(Line=crv_2, LimitDistance=ldist_2)  # -> OutLine, Info, Indexes
crv_3 = Curve(rdlines.OutLine)
crv_4 = ClusterOutput(crv_3)

# ==== cluster Cluster_2
crv = ClusterInput()
num = ClusterInput()
crv_2 = Curve(flatten(crv))
num_2 = Number(num)
end = EndPoints(Curve=crv_2)  # -> Start, End
pt = Point(end.End)
pt_2 = Point(end.Start)
merge = Merge(Data1=pt_2, Data2=pt)
rdpoints = RemoveDuplicatePointsKaramba3D(Point=merge, LimitDistance=num_2)  # -> OutPoint, Info, Indexes
pt_3 = Point(rdpoints.OutPoint)
pt_4 = ClusterOutput(pt_3)

# ==== cluster Cluster_3
data = ClusterInput()
data_2 = ClusterInput()
data_3 = Data(data)
data_4 = Data(data_2)
addition = Addition(A=data_4, B="1")
addition_2 = Addition(A=data_3, B="1")
pt = ClusterInput()
multiplication = Multiplication(A=addition, B=addition_2)
data_5 = Data(multiplication)
pt_2 = Point(flatten(pt))
dom = ConstructDomain(DomainStart=0, DomainEnd=expr("x-2", data_5))
subset = SubList(List=pt_2, Domain=dom, Wrap=True)  # -> List, Index
pt_3 = Point(subset.List)
pt_4 = ClusterOutput(pt_3)

# ==== cluster Cluster_4
crv = ClusterInput()
ldist = ClusterInput()
ldist_2 = LimitDistance(ldist)
crv_2 = Curve(simplify(crv))
explode = Explode(Curve=crv_2, Recursive=True)  # -> Segments, Vertices
crv_3 = Curve(flatten(explode.Segments))
llinter = LineLineIntersectionKaramba3D(Line=crv_3, LimitDistance_m=ldist_2)  # -> IntersectionPoints, flatten(LineSubSegements)
rdlines = RemoveDuplicateLinesKaramba3D(Line=llinter.LineSubSegements, LimitDistance=ldist_2)  # -> OutLine, Info, Indexes
crv_4 = Curve(rdlines.OutLine)
crv_5 = ClusterOutput(crv_4)

# ==== cluster Cluster_5
P = ClusterInput()
G = ClusterInput()
P_2 = Point(simplify(graft(P)))
G_2 = Geometry(G)
Z = UnitZ(Factor=1)
neg = Negative(Value=Z)
move = Move(Geometry=P_2, Motion=neg)  # -> Geometry, Transform
project = ProjectPoint(Point=move.Geometry, Direction=Z, Geometry=G_2)  # -> Point, Index
P_3 = Point(project.Point)
null = NullItem(Item=P_3)  # -> NullFlags, InvalidFlags, Description
dispatch = Dispatch(List=P_3, DispatchPattern=null.NullFlags)  # -> simplify(ListA), ListB
pt = Point(dispatch.ListB)
pt_2 = ClusterOutput(pt)
